# Grasshopper definition example1.ghx (Grasshopper 0.9.76)

number_slider = Slider(20, range=0..100)
C = Count()
series = Series(Start=0, Step=1, Count=C)
mod = Modulus(A=series, B="2")
equals = Equality(FirstNumber=mod, SecondNumber="0")  # -> Equality, Inequality
dispatch = Dispatch(List=series, DispatchPattern=equals.Equality)  # -> ListA, ListB
multiplication = Multiplication(A="2", B=dispatch.ListA)
panel = Panel(multiplication)
R = Result(multiplication)
