# Grasshopper definition example2.ghx (Grasshopper 0.9.76)

digit_scroller = DigitScroller(Scroller_Digits=12, Scroller_Prefix="B", Scroller_Radix=9, Scroller_Value=0.25)
knob = ControlKnob(Decimals=2, Limit=True, Maximum=10, Minimum=0, Range=1, Value=0.54)
W = Data(Slider(3, range=0..10))
X = Data("4")
Y = Data(knob)
multiplication = Multiplication(A=W, B=X)
addition = Addition(A=multiplication, B=Y)
division = Division(A=addition, B=digit_scroller)
Z = Data(division)
